# Grasshopper definition GHDebugSurface.gh (Grasshopper 1.0.7)

# ---- group: SurfaceFrom4Points
# All these definitions were used to convalidate and developed the NurbsSurface tests.
srf4pt = _4PointSurface(CornerA="{0.0, 0.0, 0.0}", CornerB="{10.0, 0.0, 0.0}", CornerC="{10.0, 10.0, 2.0}", CornerD="{0.0, 10.0, 4.0}")  # -> reparameterize(Surface)

# ----
panel = Panel("""0 = UDirection
1 = VDirection""")

# ---- group: SurfaceFromAGridOfPoints
srf = Surface(reparameterize(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))
srfpt = SurfacePoints(Surface=srf)  # -> Points, Weights, Greville, UCount, VCount

# ----
srfpt_2 = SurfacePoints(Surface=srf4pt)  # -> Points, Weights, Greville, UCount, VCount
panel_2 = Panel(srfpt.Points)
panel_3 = Panel(srfpt.Weights)
panel_4 = Panel(srfpt_2.Points)

# ---- group: Split
c_script = CSharpScript(srf=srf)  # -> out, bothSplits; inputs srf: Surface
# ---------- c_script: C# usings ----------
using System.Linq;
# ---------- c_script: C# ----------
    var split1 = srf.Split(1, 0.5);
    var srfs = split1.SelectMany(s => s.Split(0, 0.5)).ToList();
    bothSplits = srfs;
# ---------- end c_script ----------
c_script_2 = CSharpScript(srf=srf)  # -> out, surfsV, surfsU; inputs srf: Surface
# ---------- c_script_2: C# ----------
    surfsV = srf.Split(1, 0.5);
    surfsU = srf.Split(0, 0.5);
# ---------- end c_script_2 ----------
srfpt_3 = SurfacePoints(Surface=c_script.bothSplits)  # -> Points, Weights, Greville, UCount, VCount
srf_2 = Surface(reparameterize([c_script_2.surfsV, c_script_2.surfsU]))
srfpt_4 = SurfacePoints(Surface=c_script_2.surfsU)  # -> Points, Weights, Greville, UCount, VCount
srfpt_5 = SurfacePoints(Surface=c_script_2.surfsV)  # -> Points, Weights, Greville, UCount, VCount
panel_5 = Panel(srfpt_3.Points)
panel_6 = Panel(srfpt_5.Points)
panel_7 = Panel(srfpt_4.Points)
panel_8 = Panel(srfpt_5.UCount)
panel_9 = Panel(srfpt_5.VCount)
panel_10 = Panel(srfpt_4.UCount)
panel_11 = Panel(srfpt_4.VCount)
panel_12 = Panel(srfpt_3.Weights)
panel_13 = Panel(srfpt_4.Weights)
panel_14 = Panel(srfpt_5.Weights)
evalsrf = EvaluateSurface(Surface=reparameterize(c_script.bothSplits), Point="{0.5,0.5,0.0}")  # -> Point, Normal, UDirection, VDirection, Frame
evalsrf_2 = EvaluateSurface(Surface=srf_2, Point="{0.5,0.5,0.0}")  # -> Point, Normal, UDirection, VDirection, Frame
panel_15 = Panel(evalsrf.Point)
panel_16 = Panel(evalsrf_2.Point)

# ---- group: Loft
number_slider = Slider(2, range=0..10)
panel_17 = Panel("""{-5.0, 25.0, 0.0}
{0.0, 25.0, 20.0}
{10.0, 25.0, 0.0}""")
panel_18 = Panel("""{-20.0, 0.0, 0.0}
{0.0, 0.0, 10.0}
{10.0, 0.0, 0.0}""")
panel_19 = Panel("""{-15.0, 10.0, 0.0}
{0.0, 10.0, 5.0}
{20.0, 10.0, 1.0}""")
panel_20 = Panel("""{-5.0, 35.0, -2.0}
{0.0, 35.0, 20.0}
{5.0, 35.0, 0.0}""")
loft_opt = LoftOptions(Closed=False, Adjust=False, Rebuild=0, Refit=0, Type=Slider(1, range=0..10))
nurbs = NurbsCurve(Vertices=panel_18, Degree=number_slider, Periodic=False)  # -> Curve, Length, Domain
nurbs_2 = NurbsCurve(Vertices=panel_19, Degree=number_slider, Periodic=False)  # -> Curve, Length, Domain
nurbs_3 = NurbsCurve(Vertices=panel_17, Degree=number_slider, Periodic=False)  # -> Curve, Length, Domain
nurbs_4 = NurbsCurve(Vertices=panel_20, Degree=number_slider, Periodic=False)  # -> Curve, Length, Domain
nurbs_5 = NurbsCurve(Vertices=panel_20, Degree=number_slider, Periodic=True)  # -> Curve, Length, Domain
nurbs_6 = NurbsCurve(Vertices=panel_17, Degree=number_slider, Periodic=True)  # -> Curve, Length, Domain
nurbs_7 = NurbsCurve(Vertices=panel_18, Degree=number_slider, Periodic=True)  # -> Curve, Length, Domain
nurbs_8 = NurbsCurve(Vertices=panel_19, Degree=number_slider, Periodic=True)  # -> Curve, Length, Domain
merge = Merge(Data1=nurbs.Curve, Data2=nurbs_2.Curve, Data3=nurbs_3.Curve, Data4=nurbs_4.Curve)
merge_2 = Merge(Data1=nurbs_7.Curve, Data2=nurbs_8.Curve, Data3=nurbs_6.Curve, Data4=nurbs_5.Curve)
panel_21 = Panel("""{0.5,0.5,0.0}
{0.1,0.1,0.0}
{1.0,1.0,0.0}""")
loft = Loft(Curves=merge_2, Options=loft_opt)
loft_2 = Loft(Curves=merge, Options=loft_opt)
evalsrf_3 = EvaluateSurface(Surface=reparameterize(loft_2), Point=panel_21)  # -> Point, Normal, UDirection, VDirection, Frame
evalsrf_4 = EvaluateSurface(Surface=reparameterize(loft), Point=panel_21)  # -> Point, Normal, UDirection, VDirection, Frame
panel_22 = Panel(evalsrf_4.Point)
panel_23 = Panel(evalsrf_3.VDirection)
panel_24 = Panel(evalsrf_3.Point)

# ---- group: PointAt and VectorAt
panel_25 = Panel("""{0.5,0.5,0.0}
{0.1,0.1,0.0}
{1,1,0.0}
{0.3,0.5,0.0}""")
evalsrf_5 = EvaluateSurface(Surface=srf, Point=panel_25)  # -> Point, Normal, UDirection, VDirection, Frame
panel_26 = Panel(evalsrf_5.VDirection)
panel_27 = Panel(evalsrf_5.Point)

# ---- group: RationalDerivatives
c_script_3 = CSharpScript(srf=srf)  # -> out, derv0, dervs; inputs srf: Surface
# ---------- c_script_3: C# ----------
    Point3d pt;
    Vector3d[] derivis;
    srf.Evaluate(0.3, 0.5, 2, out pt, out derivis);
    dervs = derivis;
    derv0 = pt;
# ---------- end c_script_3 ----------
unit = UnitVector(Vector=c_script_3.dervs)
item = ListItem(List=unit, Index=0, Wrap=True)
panel_28 = Panel(c_script_3.derv0)
panel_29 = Panel(unit)
vdis = VectorDisplay(Anchor=c_script_3.derv0, Vector=item)

# ---- group: SurfaceIsocurve
c_script_4 = CSharpScript(srf=srf)  # -> out, isoV, isoU; inputs srf: Surface
# ---------- c_script_4: C# ----------
    isoV = srf.ToNurbsSurface().IsoCurve(1, 0.3);
    isoU = srf.ToNurbsSurface().IsoCurve(0, 0.3);
# ---------- end c_script_4 ----------
eval = EvaluateCurve(Curve=reparameterize(c_script_4.isoU), Parameter=0.5)  # -> Point, Tangent, Angle
cp = ControlPoints(Curve=c_script_4.isoU)  # -> Points, Weights, Knots
cp_2 = ControlPoints(Curve=c_script_4.isoV)  # -> Points, Weights, Knots
panel_30 = Panel(cp_2.Points)
panel_31 = Panel(cp_2.Weights)
panel_32 = Panel(cp.Points)
panel_33 = Panel(cp.Weights)
panel_34 = Panel(eval.Point)

# ---- group: ClosestPt and ClosestParameters
panel_35 = Panel("""{2.5, 7, 5}
{2.5, 1.5, 2}
{9, 2.5, 1}
{5, 5, 1}""")
pt = Point(panel_35)
c_script_5 = CSharpScript(testPt=pt, srf=srf)  # -> out, pt, uv; inputs testPt: Point3d, srf: Surface
# ---------- c_script_5: C# ----------
    Point3d ptAt;
    Vector3d[] derivs;
    double u; double v;
    srf.ClosestPoint(testPt, out u, out v);
    uv = new string[]{u.ToString(), v.ToString()};
    srf.Evaluate(u, v, 1, out ptAt, out derivs);
    pt = ptAt;
# ---------- end c_script_5 ----------
panel_36 = Panel(c_script_5.pt)
panel_37 = Panel(c_script_5.uv)
